# Grasshopper definition discrete curvatures.gh (Grasshopper 0.9.76)

number_slider = Slider(26, range=0..40)

line = Line(Line((258.75, 142, 0), (278.75, 142, 0)))
end = EndPoints(Curve=line)  # -> Start, End
domain = Domain(Domain(0, 180))
xy = XYPlane(Origin=end.End)
range = Range(Domain=domain, Steps=number_slider)
cull_i = CullIndex(List=range, Indices=0, Wrap=True)
hframe = HorizontalFrame(Curve=reparameterize(line), Parameter=0.5)
rotate = Rotate(Geometry=line, Angle=degrees(cull_i), Plane=xy)  # -> Geometry, Transform
deplane = DeconstructPlane(Plane=hframe)  # -> Origin, XAxis, YAxis, ZAxis
end_2 = EndPoints(Curve=rotate.Geometry)  # -> Start, End
line_2 = LineSDL(Start=deplane.Origin, Direction=deplane.YAxis, Length=100)
circle = CircleCNR(Center=[end_2.Start, end.Start, end.End], Normal=Vector(0, 0, 1), Radius=0.5)
hframe_2 = HorizontalFrame(Curve=reparameterize(rotate.Geometry), Parameter=0.5)
deplane_2 = DeconstructPlane(Plane=hframe_2)  # -> Origin, XAxis, YAxis, ZAxis
line_3 = LineSDL(Start=deplane_2.Origin, Direction=deplane_2.YAxis, Length=100)
llx = LineLine(Line1=line_2, Line2=line_3)  # -> ParamA, ParamB, PointA, PointB
dist = Distance(PointA=llx.PointA, PointB=deplane.Origin)
cir = Circle(Plane=llx.PointA, Radius=dist)

# ----
# vertex-based curvature
line_4 = Line(Line((258.75, 237, 0), (278.75, 237, 0)))
end_3 = EndPoints(Curve=line_4)  # -> Start, End
# edge-based curvature
domain_2 = Domain(Domain(0, 180))
xy_2 = XYPlane(Origin=end_3.End)
range_2 = Range(Domain=domain_2, Steps=number_slider)
cull_i_2 = CullIndex(List=range_2, Indices=0, Wrap=True)
rotate_2 = Rotate(Geometry=line_4, Angle=degrees(cull_i_2), Plane=xy_2)  # -> Geometry, Transform
end_4 = EndPoints(Curve=rotate_2.Geometry)  # -> Start, End
circle_2 = CircleCNR(Center=[end_4.Start, end_3.Start, end_3.End], Normal=Vector(0, 0, 1), Radius=0.4)
circle_3 = Circle3Pt(PointA=end_3.Start, PointB=end_3.End, PointC=end_4.Start)  # -> Circle, Plane, Radius

trim = TrimWithRegion(Curve=circle_3.Circle, Region=<geometry referenced from the Rhino model>)  # -> Inside, Outside
crv = Curve(trim.Inside)
trim_2 = TrimWithRegion(Curve=cir, Region=<geometry referenced from the Rhino model>)  # -> Inside, Outside
crv_2 = Curve(trim_2.Inside)
