# Grasshopper definition discrete curvatures.gh (Grasshopper 0.9.76)
# plug-ins: Python Interpreter

number_slider = Slider(22, range=0..29)
number_slider_2 = Slider(26, range=0..40)
crv = Curve(<curve referenced from the Rhino model>)

crv_2 = Curve(reparameterize(flatten([<curve referenced from the Rhino model> x30])))
crv_3 = Curve(<curve referenced from the Rhino model>)
crv_4 = Curve()
# energies tab
N = Slider(100, range=2..500)
python = PythonScript(crv=crv_2, N=N)  # -> out, pts, r1, r2, distance; inputs crv: list, N: Int32
# ---------- python: Python ----------
import rhinoscriptsyntax as rs
import math


def BenchCrv(crv_id,N):
    # compute primitives on a given curve
    
    n = 1000
    L = rs.CurveLength(crv_id)
    param = rs.DivideCurve(crv_id,n, False, False)
    c_mean = 0
    c2_mean = 0
    E0 = 0
    L0 = 0
    print (n)
    for i in range(n):
        
        l = rs.CurveLength(crv_id,-1,[param[i],param[i+1]])
        t = (param[i] + param[i+1])/2
        L0 = L0 + l
        c = rs.CurveCurvature(crv_id,t)[4].Length
        E0 = E0 + l*math.pow(c,2)
        c_mean += l*c
        c2_mean += l*math.pow(c,2)
    
    c_mean = c_mean/L0
    c2_mean = c2_mean/L0
    
    # compute primitives for a given approxiamation of the curve
    r1 =[]
    r2 = []
    distance = []
    subdiv = []
    
    for n in range(2,N):
        
        pts = rs.DivideCurve(crv_id,n)
        crv_discret = rs.AddPolyline(pts)
        Li = 0
        c_mean_1 = 0
        c2_mean_1 = 0
        c_mean_2 = 0
        c2_mean_2 = 0
        for i in range(1,n):
            l = rs.Distance(pts[i-1],pts[i])
            if i == 1: l = rs.Distance(pts[0],pts[1]) + rs.Distance(pts[1],pts[2])/2
            if i == n-1: l = rs.Distance(pts[n-2],pts[n-1])/2 + rs.Distance(pts[n-1],pts[n])
            Li = Li + l
            
            angle = math.pi/180*rs.VectorAngle(rs.VectorCreate(pts[i],pts[i-1]),rs.VectorCreate(pts[i+1],pts[i]))
            
            d1 = rs.Distance(pts[i-1],pts[i+1])
            c1 = 2*math.sin(angle)/d1
            c_mean_1 += l*c1
            c2_mean_1 += l*math.pow(c1,2)
            
            d2 = rs.Distance(pts[i-1],pts[i]) + rs.Distance(pts[i],pts[i+1])
            c2 = 4*math.tan(angle/2)/d2
            c_mean_2 += l*c2
            c2_mean_2 += l*math.pow(c2,2)
        
        E1 = c2_mean_1
        c_mean_1 = c_mean_1/Li
        c2_mean_1 = c2_mean_1/Li
        
        E2 = c2_mean_2
        c_mean_2 = c_mean_2/Li
        c2_mean_2 = c2_mean_2/Li

        area = rs.CurveArea(rs.JoinCurves([crv_id,crv_discret]))[0] / L0
        epsilon = area/L0
        
        distance.append(c_mean * epsilon) 
        r1.append(E1/E0)
        r2.append(E2/E0)
        subdiv.append(n)
        
    return [subdiv, distance, r1, r2]

dir = 'Z:/Public/'

count = 1

for crv_id in crv:
    if not rs.IsCurveClosed(crv_id):
        name = 'elastica'+str(count)+'.txt'
        print name
        file = open(dir+name , "w")
        res = BenchCrv(crv_id,N)
        print len(res)
        subdiv = res[0]
        distance = res[1]
        R1 = res[2]
        R2 = res[3]
        print distance
        print ""
        print R1
        print ""
        print R2
        
        file.write("{}\t{}\t{}\t{}\t{}\n".format("N","dist","1/dist","E1/E0","E2/E0"))
        for s, d, r1, r2 in zip(subdiv, distance, R1, R2):
            file.write("{}\t{}\t{}\t{}\t{}\n".format(s,d,1/d,r1,r2))
        
        file.close()
    count = count + 1
# ---------- end python ----------
division = Division(A=3.141592654, B=30)
series = Series(Start=2, Step=1, Count=N)
python_2 = PythonScript(crv=crv_2, N=N)  # -> out, pts, r, r1, r2, epsilon, dist; inputs N: Int32
# ---------- python_2: Python ----------
import rhinoscriptsyntax as rs
import math

crv_id = crv

L = rs.CurveLength(crv_id)
print "L = " + str(L)

n = 1000
param = rs.DivideCurve(crv_id,n, False, False)
print len(param)
c_mean = 0
c2_mean = 0
E0 = 0
L0 = 0
for i in range(len(param)-1):
    l = rs.CurveLength(crv_id,-1,[param[i],param[i+1]])
    t = (param[i] + param[i+1])/2
    L0 = L0 + l
    c = rs.CurveCurvature(crv_id,t)[4].Length
    E0 = E0 + l*math.pow(c,2)
    c_mean += l*c
    c2_mean += l*math.pow(c,2)

c_mean = c_mean/L0
c2_mean = c2_mean/L0

print "-------------------------------"
print "L0 = " + str(L0)
print "E0 = " + str(E0)
print "<C> = " + str(c_mean)
print "<C2> = " + str(c2_mean)
print "-------------------------------"

pts = rs.DivideCurve(crv_id,N)
crv_discret = rs.AddPolyline(pts)

Li = 0
c_mean_1 = 0
c2_mean_1 = 0
c_mean_2 = 0
c2_mean_2 = 0
print len(pts)
for i in range( 1,N):
    l = rs.Distance(pts[i-1],pts[i])
    if i == 1: l = rs.Distance(pts[0],pts[1]) + rs.Distance(pts[1],pts[2])/2
    if i == N-1: l = rs.Distance(pts[N-2],pts[N-1])/2 + rs.Distance(pts[N-1],pts[N])
    Li = Li + l
    
    angle = math.pi/180*rs.VectorAngle(rs.VectorCreate(pts[i],pts[i-1]),rs.VectorCreate(pts[i+1],pts[i]))
    
    d1 = rs.Distance(pts[i-1],pts[i+1])
    c1 = 2*math.sin(angle)/d1
    c_mean_1 += l*c1
    c2_mean_1 += l*math.pow(c1,2)
    
    d2 = rs.Distance(pts[i-1],pts[i]) + rs.Distance(pts[i],pts[i+1])
    c2 = 4*math.tan(angle/2)/d2
    c_mean_2 += l*c2
    c2_mean_2 += l*math.pow(c2,2)

E1 = c2_mean_1
c_mean_1 = c_mean_1/Li
c2_mean_1 = c2_mean_1/Li

E2 = c2_mean_2
c_mean_2 = c_mean_2/Li
c2_mean_2 = c2_mean_2/Li

print "L1 = " + str(Li)
print "E1 = " + str(E1)
print "<C> = " + str(c_mean_1)
print "<C2> = " + str(c2_mean_1)
print "-------------------------------"
print "L2 = " + str(Li)
print "E2 = " + str(E2)
print "<C> = " + str(c_mean_2)
print "<C2> = " + str(c2_mean_2)
print "-------------------------------"


area = rs.CurveArea(rs.JoinCurves([crv_id,crv_discret]))[0] / L0
epsilon = area/L0
dist = c_mean * epsilon

r1 = E1/E0
r2 = E2/E0
# ---------- end python_2 ----------
panel = Panel(python_2.r1)
panel_2 = Panel(python_2.dist)
panel_3 = Panel(python_2.r2)
pline = PolyLine(Vertices=python_2.pts, Closed=False)
merge = Merge(Data1=graft(panel_2), Data2=graft(panel), Data3=graft(panel_3))  # -> simplify(Result)
graph = QuickGraph([python_2.r, python_2.r1, python_2.r2])
panel_4 = Panel(merge)

item = ListItem(List=crv_2, Index=number_slider, Wrap=True)
elastica_txt = PythonScript(crv=crv_2, N="20", write=Toggle(True))  # -> out, T, P, E, E1, E2; inputs crv: list of Curve, N: Int32, write: Boolean
# ---------- elastica_txt: Python ----------
import rhinoscriptsyntax as rs
import Rhino.Geometry as rg
import math


def SmoothCurvature(crv, n):
    
    # ==============================================================================
    # compute smooth settings
    # ==============================================================================
    Ls = rs.CurveLength(crv)
    L = 0
    E = 0
    
    # divide curve into n edges
    param_tmp = rs.DivideCurve(crv,n, False, False)
    param = []
    param.extend(param_tmp)
    if crv.IsClosed: param.append(param[0])
    
    # divide curve into n edges
    pts_tmp = rs.DivideCurve(crv,n, False, True)
    pts = []
    pts.extend(pts_tmp)
    if crv.IsClosed: pts.append(pts[0])
    
    # SMOOTH : compute bending energy = Int_0^L (k2.ds)
    for i in range(n):
        li = rs.CurveLength(crv,-1,[param[i],param[i+1]])
        t = (param[i] + param[i+1])/2
        L = L + li
        k = rs.CurveCurvature(crv,t)[4].Length
        k = 1/rs.CurveCurvature(crv,t)[3]
        E += li*k*k
    
    print "Smooth Curvature : "
    print "E = ", E
    print "k = ", math.sqrt(E/L)
    print "L = ", L
    print "Ls = ", Ls
    print ""
    return (E, L, Ls)

def DiscreteCurvatures(crv, n):
    
    # ==============================================================================
    # compute smooth settings
    # ==============================================================================
    
    L = 0
    E1 = 0
    E2 = 0
    
    # divide curve into n edges
    param_tmp = rs.DivideCurve(crv,n, False, False)
    param = []
    param.extend(param_tmp)
    if crv.IsClosed: param.append(param[0])
    
    # divide curve into n edges
    pts_tmp = rs.DivideCurve(crv,n, False, True)
    pts = []
    pts.extend(pts_tmp)
    if crv.IsClosed: pts.append(pts[0])
    
    # DISCRETE 1 : compute bending energy = Int_0^L (k1.ds)
    # we assume a null curvature at vertices x0 and xn
    
    for i in range(1,n):
        e1 = rg.Vector3d(pts[i] - pts[i-1])
        e2 = rg.Vector3d(pts[i+1] - pts[i])
        l1 = e1.Length
        l2 = e2.Length
        ll = (e1+e2).Length
        
        li = 0.5 * (l1+l2)
        #if i == 1 : li += l1/2
        #if i == n-1 : li += l2/2
        L += li
        
        
        kb1 = 2 * rg.Vector3d.CrossProduct(e1,e2) / (l1*l2*ll)
        k1 = kb1.Length
        E1 += li * k1*k1
        print "k1 = ", k1
        
        kb2 = (4/(l1+l2)) * rg.Vector3d.CrossProduct(e1,e2) / (l1*l2 + rg.Vector3d.Multiply(e1,e2))
        k2 = kb2.Length
        E2 += li * k2*k2
        print "k2 = ", k2
        
        print ""
    
    print "Discrete Curvatures : "
    print "E1 = ", E1
    print "E2 = ", E2
    print "L = ", L
    return (E1, E2, param, pts)

def WriteTab(crvs, n):
    
    dir = 'Z:/Public/'
    dir = 'C:/Users/Admin/Desktop/'
    count = 1
    
    for crv in crvs :
        fileName = 'elastica_'+str(count)+'.txt'
        file = open(dir+fileName , "w")
        
        E = SmoothCurvature(crv, 1000)[0]
        E1 = []
        E2 = []
        for i in range(2,n+1):
            res = DiscreteCurvatures(crv,i)
            E1.append(res[0])
            E2.append(res[1])
       
        file.write("{}\t{}\t{}\t{}\t{}\t{}\t{}\t{}\n".format("N","E", "E1", "E2", "E1/E0","E2/E0", "|1-E1/E0|(percent)","|1-E2/E0|(percent)"))
        for N, e1, e2 in zip(range(2,n+1), E1, E2):
            file.write("{}\t{}\t{}\t{}\t{}\t{}\t{}\t{}\n".format(N, E, e1, e2, e1/E, e2/E, abs(1-e1/E)*100, abs(1-e2/E)*100))
        file.close()
        
        count+=1

if write : WriteTab(crv, 50)
# ---------- end elastica_txt ----------
semicircle_txt = PythonScript(crv=crv, N="20", write=Toggle(True))  # -> out, T, P, E, E1, E2; inputs crv: list of Curve, N: Int32, write: Boolean
# ---------- semicircle_txt: Python ----------
import rhinoscriptsyntax as rs
import Rhino.Geometry as rg
import math


def WriteTab(crvs, n):
    
    dir = 'Z:/Public/'
    dir = 'C:/Users/Admin/Desktop/'
    count = 1
    
    for crv in crvs :
        fileName = 'semicircle'+'.txt'
        file = open(dir+fileName , "w")
        file.write("{}\t{}\t{}\t{}\t{}\t{}\t{}\t{}\n".format("N","E", "E1", "E2", "E1/E0","E2/E0", "|1-E1/E0|(percent)","|1-E2/E0|(percent)"))
        
        E = SmoothCurvature(crv, 1000)[0]
        
        # we assume the curve is a semicircle
        L = rs.CurveLength(crv)
        k = math.pi/L
        print E
        print L*k*k
        
        for N in range(2,n+1):
            phi = math.pi / N
            r1 = math.sin(phi/2) / (phi/2)
            r2 = r1/(math.cos(phi/2)*math.cos(phi/2))
            e1 = E*r1
            e2 = E*r2
            file.write("{}\t{}\t{}\t{}\t{}\t{}\t{}\t{}\n".format(N, E, e1, e2, e1/E, e2/E, abs(1-e1/E)*100, abs(1-e2/E)*100))
        
        file.close()
        
        count+=1


if write : WriteTab(crv, 50)
# ---------- end semicircle_txt ----------
elastica = PythonScript(crv=item, N=Slider(16, range=2..29))  # -> out, T, P, E, E1, E2, R1, R2; inputs crv: Curve, N: Int32
# ---------- elastica: Python ----------
import rhinoscriptsyntax as rs
import Rhino.Geometry as rg
import math

def SmoothCurvature(crv, n):
    
    # ==============================================================================
    # compute smooth settings
    # ==============================================================================
    Ls = rs.CurveLength(crv)
    L = 0
    E = 0
    
    # divide curve into n edges
    param_tmp = rs.DivideCurve(crv,n, False, False)
    param = []
    param.extend(param_tmp)
    if crv.IsClosed: param.append(param[0])
    
    # divide curve into n edges
    pts_tmp = rs.DivideCurve(crv,n, False, True)
    pts = []
    pts.extend(pts_tmp)
    if crv.IsClosed: pts.append(pts[0])
    
    # SMOOTH : compute bending energy = Int_0^L (k2.ds)
    for i in range(n):
        li = rs.CurveLength(crv,-1,[param[i],param[i+1]])
        t = (param[i] + param[i+1])/2
        L = L + li
        k = rs.CurveCurvature(crv,t)[4].Length
        k = 1/rs.CurveCurvature(crv,t)[3]
        E += li*k*k
    
    print "Smooth Curvature : "
    print "E = ", E
    print "k = ", math.sqrt(E/L)
    print "L = ", L
    print "Ls = ", Ls
    print ""
    return (E, L, Ls)

def DiscreteCurvatures(crv, n):
    
    # ==============================================================================
    # compute smooth settings
    # ==============================================================================
    
    L = 0
    E1 = 0
    E2 = 0
    
    # divide curve into n edges
    param_tmp = rs.DivideCurve(crv,n, False, False)
    param = []
    param.extend(param_tmp)
    if crv.IsClosed: param.append(param[0])
    
    # divide curve into n edges
    pts_tmp = rs.DivideCurve(crv,n, False, True)
    pts = []
    pts.extend(pts_tmp)
    if crv.IsClosed: pts.append(pts[0])
    
    # DISCRETE 1 : compute bending energy = Int_0^L (k1.ds)
    # we assume a null curvature at vertices x0 and xn
    
    for i in range(1,n):
        e1 = rg.Vector3d(pts[i] - pts[i-1])
        e2 = rg.Vector3d(pts[i+1] - pts[i])
        l1 = e1.Length
        l2 = e2.Length
        ll = (e1+e2).Length
        
        li = 0.5 * (l1+l2)
        #if i == 1 : li += l1/2
        #if i == n-1 : li += l2/2
        L += li
        
        
        kb1 = 2 * rg.Vector3d.CrossProduct(e1,e2) / (l1*l2*ll)
        k1 = kb1.Length
        E1 += li * k1*k1
        print "k1 = ", k1
        
        kb2 = (4/(l1+l2)) * rg.Vector3d.CrossProduct(e1,e2) / (l1*l2 + rg.Vector3d.Multiply(e1,e2))
        k2 = kb2.Length
        E2 += li * k2*k2
        print "k2 = ", k2
        
        print ""
    
    print "Discrete Curvatures : "
    print "E1 = ", E1
    print "E2 = ", E2
    print "L = ", L
    return (E1, E2, param, pts)

def WriteTab(crvs, n):
    
    dir = 'Z:/Public/'
    dir = 'C:/Users/Admin/Desktop/'
    count = 1
    
    for crv in crvs :
        fileName = 'elastica_'+str(count)+'.txt'
        file = open(dir+fileName , "w")
        
        E = SmoothCurvature(crv, 1000)[0]
        E1 = []
        E2 = []
        for i in range(2,n+1):
            res = DiscreteCurvatures(crv,i)
            E1.append(res[0]/E)
            E2.append(res[1]/E)
       
        file.write("{}\t{}\t{}\n".format("N","E1/E0","E2/E0"))
        for N, r1, r2 in zip(range(2,n+1), E1, E2):
            file.write("{}\t{}\t{}\n".format(N,r1,r2))
        file.close()
        
        count+=1

E = SmoothCurvature(crv, 100)[0]


(E1, E2, param, pts) = DiscreteCurvatures(crv,N)
R1 = abs(1-E1/E)*100
R2 = abs(1-E2/E)*100

print R1
print R2
print abs(R2-R1)/R1

T = param
P = pts
# ---------- end elastica ----------

panel_5 = Panel("8")
crv_5 = Curve(<curve referenced from the Rhino model>)
explode = Explode(Curve=crv_5, Recursive=True)  # -> Segments, Vertices
cp = ControlPoints(Curve=crv_5)  # -> Points, Weights, Knots
intcrv = Interpolate(Vertices=cp.Points, Degree=3, Periodic=False, KnotStyle=1)  # -> Curve, Length, Domain
end = EndPoints(Curve=explode.Segments)  # -> Start, End
vec2pt = Vector2Pt(PointA=end.Start, PointB=end.End, Unitize=False)  # -> Vector, Length
line = LineSDL(Start=end.End, Direction=vec2pt.Vector, Length=12)

line_2 = Line(Line((258.75, 182, 0), (278.75, 182, 0)))
end_2 = EndPoints(Curve=line_2)  # -> Start, End
domain = Domain(Domain(0, 180))
xy = XYPlane(Origin=end_2.End)
range = Range(Domain=domain, Steps=number_slider_2)
cull_i = CullIndex(List=range, Indices=0, Wrap=True)
hframe = HorizontalFrame(Curve=reparameterize(line_2), Parameter=0.5)
rotate = Rotate(Geometry=line_2, Angle=degrees(cull_i), Plane=xy)  # -> Geometry, Transform
deplane = DeconstructPlane(Plane=hframe)  # -> Origin, XAxis, YAxis, ZAxis
end_3 = EndPoints(Curve=rotate.Geometry)  # -> Start, End
line_3 = LineSDL(Start=deplane.Origin, Direction=deplane.YAxis, Length=100)
circle = CircleCNR(Center=[end_3.Start, end_2.Start, end_2.End], Normal=Vector(0, 0, 1), Radius=0.5)
hframe_2 = HorizontalFrame(Curve=reparameterize(rotate.Geometry), Parameter=0.5)
deplane_2 = DeconstructPlane(Plane=hframe_2)  # -> Origin, XAxis, YAxis, ZAxis
line_4 = LineSDL(Start=deplane_2.Origin, Direction=deplane_2.YAxis, Length=100)
llx = LineLine(Line1=line_3, Line2=line_4)  # -> ParamA, ParamB, PointA, PointB
dist = Distance(PointA=llx.PointA, PointB=deplane.Origin)
cir = Circle(Plane=llx.PointA, Radius=dist)

smaller = SmallerThan(FirstNumber=elastica.R1, SecondNumber=elastica.R2)  # -> SmallerThan, OrEqualTo

# ----
# vertex-based curvature
line_5 = Line(Line((258.75, 257, 0), (278.75, 257, 0)))
end_4 = EndPoints(Curve=line_5)  # -> Start, End
# edge-based curvature
domain_2 = Domain(Domain(0, 180))
xy_2 = XYPlane(Origin=end_4.End)
range_2 = Range(Domain=domain_2, Steps=number_slider_2)
cull_i_2 = CullIndex(List=range_2, Indices=0, Wrap=True)
rotate_2 = Rotate(Geometry=line_5, Angle=degrees(cull_i_2), Plane=xy_2)  # -> Geometry, Transform
end_5 = EndPoints(Curve=rotate_2.Geometry)  # -> Start, End
circle_2 = CircleCNR(Center=[end_5.Start, end_4.Start, end_4.End], Normal=Vector(0, 0, 1), Radius=0.4)
circle_3 = Circle3Pt(PointA=end_4.Start, PointB=end_4.End, PointC=end_5.Start)  # -> Circle, Plane, Radius

pline_2 = PolyLine(Vertices=elastica.P, Closed=False)
explode_2 = Explode(Curve=pline_2, Recursive=True)  # -> Segments, Vertices
crv_cp = CurveClosestPoint(Point=cp.Points, Curve=intcrv.Curve)  # -> Point, Parameter, Distance
points = PointList(Points=elastica.P, Size=2)
graph_2 = QuickGraph([elastica.E1, elastica.E2])
item_2 = ListItem(List=elastica_txt.P, Index=number_slider, Wrap=True)
graph_3 = QuickGraph([elastica.E1, elastica.E2])
panel_6 = Panel(smaller.SmallerThan)
end_6 = EndPoints(Curve=explode_2.Segments)  # -> Start, End
frame = CurveFrame(Curve=intcrv.Curve, Parameter=crv_cp.Parameter)
vec2pt_2 = Vector2Pt(PointA=end_6.Start, PointB=end_6.End, Unitize=False)  # -> Vector, Length
deplane_3 = DeconstructPlane(Plane=frame)  # -> Origin, XAxis, YAxis, ZAxis
cir_2 = Circle(Plane=cp.Points, Radius=0.7)
panel_7 = Panel(vec2pt_2.Vector)
panel_8 = Panel(elastica.out)
line_6 = LineSDL(Start=crv_cp.Point, Direction=deplane_3.XAxis, Length=6)
trim = TrimWithRegion(Curve=circle_3.Circle, Region=<geometry referenced from the Rhino model>)  # -> Inside, Outside
crv_6 = Curve(trim.Inside)
panel_9 = Panel(elastica.R2)
trim_2 = TrimWithRegion(Curve=cir, Region=<geometry referenced from the Rhino model>)  # -> Inside, Outside
crv_7 = Curve(trim_2.Inside)
