# Grasshopper definition balance.gh (Grasshopper 0.9.76)
# plug-ins: TMarsupilami

# ---- group: FRAME
origin = Point(Point(0, 0, 0))
d1 = Vector(Vector(0, 0, 1))
d2 = Vector(Vector(0, 1, 0))
pl = ConstructPlane(Origin=origin, XAxis=d1, YAxis=d2)
deplane = DeconstructPlane(Plane=pl)  # -> Origin, XAxis, YAxis, ZAxis
d3 = Vector(deplane.ZAxis)
fdis = FrameDisplay(Frame=pl, ScaleFactor=1, LineWidth=[1, 1, 2], Color=[RGB(255, 0, 0), RGB(0, 255, 0), RGB(0, 0, 255)])

# ---- group: CURVATURE
r1 = Panel("50")
r2 = Panel("-50")
k1 = Number(expr("1/x", r1))
k2 = Number(expr("1/x", r2))
multiplication = Multiplication(A=d1, B=k1)
multiplication_2 = Multiplication(A=d2, B=k2)
addition = Addition(A=multiplication, B=multiplication_2)
kb = Vector(addition)
r = Number(expr("1/x", kb))
r_2 = Panel(r)

# ----
kb1 = Vector(multiplication)
kb2 = Vector(multiplication_2)

# ---- group: C2
kb_2 = Vector(kb2)
origin_2 = Point(origin)
d3_2 = Vector(d3)
xprod = CrossProduct(VectorA=kb_2, VectorB=d3_2, Unitize=False)  # -> unitize(Vector), Length
r_3 = Number(expr("1/x", kb_2))
n = Vector(xprod.Vector)
multiplication_3 = Multiplication(A=n, B=r_3)
move = Move(Geometry=origin_2, Motion=multiplication_3)  # -> Geometry, Transform
circle = CircleCNR(Center=move.Geometry, Normal=kb_2, Radius=r_3)

# ---- group: C1
origin_3 = Point(origin)
kb_3 = Vector(kb1)
d3_3 = Vector(d3)
xprod_2 = CrossProduct(VectorA=kb_3, VectorB=d3_3, Unitize=False)  # -> unitize(Vector), Length
r_4 = Number(expr("1/x", kb_3))
n_2 = Vector(xprod_2.Vector)
multiplication_4 = Multiplication(A=n_2, B=r_4)
move_2 = Move(Geometry=origin_3, Motion=multiplication_4)  # -> Geometry, Transform
circle_2 = CircleCNR(Center=move_2.Geometry, Normal=kb_3, Radius=r_4)

# ---- group: C
origin_4 = Point(origin)
kb_4 = Vector(kb)
d3_4 = Vector(d3)
xprod_3 = CrossProduct(VectorA=kb_4, VectorB=d3_4, Unitize=False)  # -> unitize(Vector), Length
r_5 = Number(expr("1/x", kb_4))
n_3 = Vector(xprod_3.Vector)
multiplication_5 = Multiplication(A=n_3, B=r_5)
move_3 = Move(Geometry=origin_4, Motion=multiplication_5)  # -> Geometry, Transform
circle_3 = CircleCNR(Center=move_3.Geometry, Normal=kb_4, Radius=r_5)

# ----
number_slider = Slider(120, range=0..200)
crv = Curve(circle_3)
division = Division(A=number_slider, B=2)
divide = DivideCurve(Curve=crv, Count=number_slider, Kinks=False)  # -> Points, Tangents, Parameters
dom = ConstructDomain(DomainStart=division, DomainEnd=expr("x+10", division))
subset = SubList(List=divide.Points, Domain=dom, Wrap=True)  # -> List, Index
subset_2 = SubList(List=divide.Tangents, Domain=dom, Wrap=True)  # -> List, Index
subset_3 = SubList(List=divide.Parameters, Domain=dom, Wrap=True)  # -> List, Index
mvector = Vector(subset_2.List)
item = ListItem(List=subset_3.List, Index=-1, Wrap=True)
item_2 = ListItem(List=subset_3.List, Index=0, Wrap=True)
tstart = Number(item_2)
tend = Number(item)
dom_2 = ConstructDomain(DomainStart=tstart, DomainEnd=tend)
z_pt_rot = ZParallelTransportAFrameRotation(Frame=pl, TargetPointS=subset.List, TargetDirectionS=subset_2.List, Include=False)
subcrv = SubCurve(BaseCurve=crv, Domain=dom_2)

mframe = Frame(z_pt_rot)
rad = Radians(Degrees=2)
lng = ListLength(List=mframe)
series = Series(Start=0, Step=rad, Count=lng)
rz = ZRotateAFrame(FrameS=mframe, ZTwistAngleS=series)

number_slider_2 = Slider(4, range=0..5)
number_slider_3 = Slider(2, range=0..5)
mframe_2 = Frame(rz)
pln = Plane(pl)
dom_3 = ConstructDomain(DomainStart=expr("-x", number_slider_2), DomainEnd=number_slider_2)
dom_4 = ConstructDomain(DomainStart=expr("-x", number_slider_3), DomainEnd=number_slider_3)
rectangle = Rectangle(Plane=pln, XSize=dom_3, YSize=dom_4, Radius=0)  # -> Rectangle, Length
orient = Orient(Geometry=rectangle.Rectangle, Source=pln, Target=mframe_2)  # -> Geometry, Transform

swp1 = Sweep1(Rail=subcrv, Sections=orient.Geometry, Miter=1)
