# Grasshopper definition section deformations.gh (Grasshopper 0.9.76)
# plug-ins: TMarsupilami

number_slider = Slider(15, range=0..200)  # disabled
sqgrid = Square(Plane=PlaneXY(322.5, 62, 0), Size=2, ExtentX=5, ExtentY=15)  # -> Cells, Points
boundary = BoundarySurfaces(Edges=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)
srf = Surface(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)
sprop = SectionProperties(TheSection=srf)  # -> F, A, I1, I2, I3, I
boundary_2 = BoundarySurfaces(Edges=<geometry referenced from the Rhino model>)
pt = Point(<point referenced from the Rhino model>)
sqgrid_2 = Square(Plane=PlaneXY(322.5, 62, 0), Size=2, ExtentX=5, ExtentY=15)  # -> Cells, Points
panel = Panel("6.5/35")  # disabled
panel_2 = Panel("50")  # disabled
divide = DivideCurve(Curve=<geometry referenced from the Rhino model>, Count=number_slider, Kinks=False)  # -> Points, Tangents, Parameters; disabled
matrix = DisplayMatrix(sprop.I, Digits=0)
pt_2 = ConstructPoint(XCoordinate=0, YCoordinate=0, ZCoordinate=0)
srf_2 = Surface(boundary)
sdivide = DivideSurface(Surface=boundary_2, UCount=Slider(10, range=0..200), VCount=Slider(15, range=0..200))  # -> simplify(Points), simplify(Normals), simplify(Parameters)
boundary_3 = BoundarySurfaces(Edges=<geometry referenced from the Rhino model>)
planar = IsPlanar(Surface=srf_2, Interior=True)  # -> Planar, Plane
pt_3 = Point(<point referenced from the Rhino model>)
pt_4 = ConstructPoint(XCoordinate=0, YCoordinate=0, ZCoordinate=0)  # disabled
pt_5 = Point(<point referenced from the Rhino model>)
crv = Curve(<curve referenced from the Rhino model>)  # disabled
vec2pt = Vector2Pt(PointA=pt_3, PointB=pt_2, Unitize=False)  # -> Vector, Length
pt_6 = ConstructPoint(XCoordinate=0, YCoordinate=0, ZCoordinate=0)
# Computes the section principal axes and corresponding tensor of inertia. The strong axis is always the first. The weak axis is the second. The perpendicular to the section planar surface is the third axis.
principal_axes = CSharpScript(srf=srf_2, Reference="C:\Users\Admin\AppData\Roaming\Grasshopper\Libraries\alglibnet2.dll")  # -> out, P, S, I1, I2, I3, I; inputs srf: Surface
# ---------- principal_axes: C# ----------
    double tolerance = 1e-8;

    // Make sure the surface is planar
    Plane surfacePlane;
    if(srf.TryGetPlane(out surfacePlane, tolerance))
    {
      Print("Plane : " + surfacePlane.XAxis);
      Print("Plane : " + surfacePlane.YAxis);
      Print("Plane : " + surfacePlane.ZAxis);

      // Position the surface plane at the centroid
      var amp = AreaMassProperties.Compute(srf);
      var centroid = amp.Centroid;
      var a = centroid.X;
      var b = centroid.Y;
      var c = centroid.Z;
      surfacePlane.Origin = centroid;

      // Get section area
      var A = amp.Area;

      // Compute the inertia tensor in the world coordinate system ROxyz = {O,ex,ey,ez}
      var IO_xx = amp.WorldCoordinatesMomentsOfInertia.X;
      var IO_yy = amp.WorldCoordinatesMomentsOfInertia.Y;
      var IO_zz = amp.WorldCoordinatesMomentsOfInertia.Z;
      var IO_xy = -amp.WorldCoordinatesProductMoments.X;
      var IO_xz = -amp.WorldCoordinatesProductMoments.Z;
      var IO_yz = -amp.WorldCoordinatesProductMoments.Y;

      // Compute the inertia tensor in the world coordinate system RGxyz = {G,ex,ey,ez} translated to the centroid (G)
      // this requires Huygens theorem
      var IG_xx = IO_xx - A * (b * b + c * c);
      var IG_yy = IO_yy - A * (a * a + c * c);
      var IG_zz = IO_zz - A * (a * a + b * b);
      var IG_xy = IO_xy + A * a * b;
      var IG_xz = IO_xz + A * a * c;
      var IG_yz = IO_yz + A * b * c;

      var IGxyz = new Matrix(3, 3);
      IGxyz[0, 0] = IG_xx;    IGxyz[0, 1] = IG_xy;    IGxyz[0, 2] = IG_xz;
      IGxyz[1, 0] = IG_xy;    IGxyz[1, 1] = IG_yy;    IGxyz[1, 2] = IG_yz;
      IGxyz[2, 0] = IG_xz;    IGxyz[2, 1] = IG_yz;    IGxyz[2, 2] = IG_zz;

      // #####################
      // first change of basis
      // #####################

      // We express the inertia tensor in the surfacePlane coordinate system RGijk = {G, ei, ej, ek}.
      // We know that ek is normal to the surface and that ei and ej lie on the surface.
      // Thus the tensor components : IG_ik = IG_jk = 0 and IG_kk will be the polar inertia and third eigen value

      // We call P1 the transformation matrix from RGijk to RGxyz, that is the columns of P1 are {ei,ej,ek}.
      // We call TP1 the transpose of P1.
      var ei = surfacePlane.XAxis;
      var ej = surfacePlane.YAxis;
      var ek = surfacePlane.ZAxis;
      var P1 = new Matrix(3, 3);
      P1[0, 0] = ei.X;       P1[0, 1] = ej.X;       P1[0, 2] = ek.X;
      P1[1, 0] = ei.Y;       P1[1, 1] = ej.Y;       P1[1, 2] = ek.Y;
      P1[2, 0] = ei.Z;       P1[2, 1] = ej.Z;       P1[2, 2] = ek.Z;


      Print("Plane : " + ei);
      Print("Plane : " + ej);
      Print("Plane : " + ek);

      // The Inertia tensor in RGijk is now : IGijk = TP1 x IG_RGxyz x P1
      var TP1 = P1.Duplicate(); TP1.Transpose();
      var IGijk = TP1 * IGxyz * P1;
      var IG_ii = IGijk[0, 0];
      var IG_jj = IGijk[1, 1];
      var IG_kk = IGijk[2, 2];
      var IG_ij = IGijk[0, 1];

      // #######################
      // second change of basis
      // #######################

      // based on : http://scipp.ucsc.edu/~haber/ph116A/diag2x2_11.pdf

      // We know the third eigen value and corresponding eigen vector for IGxyz :
      var e3 = ek;
      var IG_33 = IG_kk;

      // We have now a simpler 2x2 diagonalisation problem to solve, that is a rotation in the plane perpendicular to e3 = ek
      // The remaining eigen values satisfy the following equation : l^2 - (IG_ii + IG_jj)l + (IG_ii*IG_jj) - IG_ij^2 = 0
      var D = Math.Sqrt((IG_ii - IG_jj) * (IG_ii - IG_jj) + 4 * IG_ij * IG_ij);
      var IG_11 = 0.5 * ((IG_ii + IG_jj) + D); // strong axis
      var IG_22 = 0.5 * ((IG_ii + IG_jj) - D); // weak axis (IG_22 < IG_11)

      Print("IG_11 = " + IG_11);
      Print("IG_22 = " + IG_22);
      Print("IG_33 = " + IG_33);

      Print("v1" + (2 * IG_ij * ei));
      Print("v2 = " + (IG_jj - IG_ii + D) * ej);


      // The eigen vector e1 associated with eigen value IG_11 is given by :
      var e1 = 2 * IG_ij * ei + (IG_jj - IG_ii + D) * ej;
      e1.Unitize();

      // The eigen vector e2 associated with eigen value IG_22 is given by :
      var e2 = 2 * IG_ij * ei + (IG_jj - IG_ii - D) * ej;
      e2.Unitize();

      // Thus, the sectioPlane si given by {G, e1, e2, e3 = e1 x e2}
      var sectionPlane = new Plane(centroid, e1, Vector3d.CrossProduct(e3, e1));


      Print("e1 = " + e1);
      Print("e2 = " + e2);
      Print("e3 = " + e3);

      // We call P2 the transformation matrix from RG123 to RGxyz, that is the columns of P2 are {e1,e2,e3}.
      // We call TP2 the transpose of P2.
      var P2 = new Matrix(3, 3);
      P2[0, 0] = e1.X; P2[0, 1] = e2.X; P2[0, 2] = e3.X;
      P2[1, 0] = e1.Y; P2[1, 1] = e2.Y; P2[1, 2] = e3.Y;
      P2[2, 0] = e1.Z; P2[2, 1] = e2.Z; P2[2, 2] = e3.Z;
      var TP2 = P2.Duplicate(); TP2.Transpose();
      var IG123 = TP2 * IGxyz * P2;

      // the previous computation is not necessary has we already know that IG123 = diag(IG_11, IG_22, IG_33)
      // but it's a way to check the results
      //var IG123 = new Matrix(3, 3);
      //IG123[0, 0] = IG_11;
      //IG123[1, 1] = IG_22;
      //IG123[2, 2] = IG_33;

      P = sectionPlane;
      S = A;
      I1 = IG_11;
      I2 = IG_22;
      I3 = IG_33;
      I = IG123;
      Iijk = IGijk;
    }
    else
    {
      Print("Non Planar Surface");
    }
# ---------- end principal_axes ----------
pt_7 = Point(sdivide.Points)
pt_8 = Point(<point referenced from the Rhino model>)  # disabled
sdivide_2 = DivideSurface(Surface=boundary_3, UCount=Slider(10, range=0..200), VCount=Slider(15, range=0..200))  # -> simplify(Points), simplify(Normals), simplify(Parameters)
xy = XYPlane(Origin=Point(0, 0, 0))
curvature = Curvature(Curve=crv, Parameter=0)  # -> P, K, C; disabled
pln = Plane(curvature.C)  # disabled
vec2pt_2 = Vector2Pt(PointA=pt_8, PointB=pt_4, Unitize=False)  # -> Vector, Length; disabled
panel_3 = Panel("2*35/30")  # disabled
multiplication = Multiplication(A=panel_3, B=panel)  # disabled
series = Series(Start=expr("-x/2", 0), Step=multiplication, Count=panel_2)  # disabled
pt_9 = Point(<point referenced from the Rhino model>)
len = Length(Curve=curvature.C)  # disabled
pt_10 = Point(pt_7)  # disabled
move = Move(Geometry=pt_7, Motion=vec2pt.Vector)  # -> Geometry, Transform
vec2pt_3 = Vector2Pt(PointA=pt_9, PointB=pt_6, Unitize=False)  # -> Vector, Length
# Align the section to OXY plane and use the built-in component for area moments about world axis. Check the results.
orient = Orient(Geometry=srf_2, Source=principal_axes.P, Target=xy)  # -> Geometry, Transform
panel_4 = Panel("2*pi")  # disabled
division = Division(A=len, B=panel_3)  # disabled
pt_11 = Point(sdivide_2.Points)
sprop_2 = SectionProperties(TheSection=orient.Geometry)  # -> F, A, I1, I2, I3, I
matrix_2 = DisplayMatrix(principal_axes.I, Digits=0)
number_slider_2 = Slider(0.12, range=-0.5..0.5)  # disabled
number_slider_3 = Slider(0.1, range=0..0.5)  # disabled
number_slider_4 = Slider(0.06, range=-0.5..0.5)  # disabled
number_slider_5 = Slider(0.16, range=0..0.5)  # disabled
move_2 = Move(Geometry=pt_10, Motion=vec2pt_2.Vector)  # -> Geometry, Transform; disabled
pdecon = Deconstruct(Point=move.Geometry)  # -> XComponent, YComponent, ZComponent
division_2 = Division(A=panel_4, B=division)  # disabled
series_2 = Series(Start=expr("0", division_2), Step=division_2, Count=panel_2)  # disabled
amoments = AreaMoments(Geometry=orient.Geometry)  # -> Area, Centroid, Inertia, InertiaError, Secondary, SecondaryError, Gyration
move_3 = Move(Geometry=pt_11, Motion=vec2pt_3.Vector)  # -> Geometry, Transform
number_slider_6 = Slider(0.1, range=-0.5..0.5)  # disabled
number_slider_7 = Slider(0.4, range=-0.5..0.5)  # disabled
number_slider_8 = Slider(0.2, range=0..0.5)  # disabled
number_slider_9 = Slider(0, range=0..0.5)  # disabled
pdecon_2 = Deconstruct(Point=move_2.Geometry)  # -> XComponent, YComponent, ZComponent; disabled
x2 = Number(expr("-x", pdecon.XComponent))
crv_2 = Curve(<curve referenced from the Rhino model>)  # disabled
crv_3 = Curve(<curve referenced from the Rhino model>)  # disabled
pt_12 = Point(<point referenced from the Rhino model>)  # disabled
x1 = Number(pdecon.YComponent)
pt_13 = Point(<point referenced from the Rhino model>)  # disabled
pdecon_3 = Deconstruct(Point=pt_11)  # -> XComponent, YComponent, ZComponent
rotate = Rotate(Geometry=pt_13, Angle=expr("-x", series_2), Plane=pln)  # -> Geometry, Transform; disabled
rotate_2 = Rotate(Geometry=crv_3, Angle=expr("-x", series_2), Plane=pln)  # -> Geometry, Transform; disabled
rotate_3 = Rotate(Geometry=crv_2, Angle=series_2, Plane=pln)  # -> Geometry, Transform; disabled
U = CSharpScript(
    X1=x1,
    X2=x2,
    e=Slider(0, range=0..0.5),
    w1=Slider(0.106, range=-0.5..0.5),
    w2=Slider(0.04, range=-0.5..0.5),
    w3=Slider(0, range=0..0.5))  # -> out, u; inputs X1: Double, X2: Double, e: Double, w1: Double, w2: Double, w3: Double
# ---------- U: C# ----------
    var E = 20e9;
    var G = 5e9;
    var v = 0.3;

    var _w1 = 0;
    var _w2 = 0;
    var _w3 = 0;

    var u1 = -v * e * X1 - v * (w1 - _w1) * X1 * X2 + 0.5 * v * (w2 - _w2) * (X1 * X1 - X2 * X2);
    var u2 = -v * e * X2 + v * (w2 - _w2) * X1 * X2 + 0.5 * v * (w1 - _w1) * (X1 * X1 - X2 * X2);
    var u3 = (w3 - _w3) * phi_rect(X1, X2);

    u = new Vector3d(u1, u2, u3);
# ---------- U: C# additional code ----------
  public double phi(double X1, double X2)
  {
    return X1 * X2;
  }

  public double phi_rect(double X1, double X2)
  {
    double a = 5;
    double b = 10;
    int N = 10;

    double phi = X1 * X2;

    double sum = 0;
    for (int n = 0; n < N; n++)
    {
      var kn = (2 * n + 1) * Math.PI / (2 * a);
      sum += Math.Pow(-1, n) * Math.Sin(kn * X1) * Math.Sinh(kn * X2) / (Math.Pow(2 * n + 1, 3) * Math.Cosh(kn * b));
    }

    phi -= 32 * a * a / Math.Pow(Math.PI, 3) * sum;

    return phi;
  }
# ---------- end U ----------
panel_5 = Panel(U.u)
rotate_4 = Rotate(Geometry=pt_12, Angle=series_2, Plane=pln)  # -> Geometry, Transform; disabled
area_moment_in_xyz = Panel(amoments.Inertia)
x1_2 = Number(pdecon_2.YComponent)  # disabled
U_2 = CSharpScript(X1=x1_2, X2=0, e=number_slider_9, w1=number_slider_6, w2=number_slider_7, w3=number_slider_8)  # -> out, u; inputs X1: Double, X2: Double, e: Double, w1: Double, w2: Double, w3: Double; disabled; same code as U
panel_6 = Panel(U_2.u)  # disabled
xy_2 = XYPlane(Origin=rotate_4.Geometry)  # disabled
xy_3 = XYPlane(Origin=rotate.Geometry)  # disabled
pdecon_4 = Deconstruct(Point=U.u)  # -> XComponent, YComponent, ZComponent

pdecon_5 = Deconstruct(Point=amoments.Inertia)  # -> XComponent, YComponent, ZComponent
subtraction = Subtraction(A=principal_axes.I1, B=pdecon_5.XComponent)
subtraction_2 = Subtraction(A=principal_axes.I2, B=pdecon_5.YComponent)
subtraction_3 = Subtraction(A=principal_axes.I3, B=pdecon_5.ZComponent)
panel_7 = Panel(subtraction)
panel_8 = Panel(subtraction_2)
panel_9 = Panel(subtraction_3)

U_3 = CSharpScript(
    X1=pdecon_3.XComponent,
    X2=pdecon_3.YComponent,
    e=Slider(0, range=0..0.5),
    w1=Slider(0.056, range=-0.5..0.5),
    w2=Slider(0, range=-0.5..0.5),
    w3=Slider(0, range=0..0.5))  # -> out, u; inputs X1: Double, X2: Double, e: Double, w1: Double, w2: Double, w3: Double; same code as U
panel_10 = Panel(U_3.u)
panel_11 = Panel("20")  # disabled
rotate_5 = Rotate(Geometry=rotate_3.Geometry, Angle=expr("-x", degrees(series)), Plane=xy_2)  # -> Geometry, Transform; disabled
rotate_6 = Rotate(Geometry=rotate_2.Geometry, Angle=degrees(series), Plane=xy_3)  # -> Geometry, Transform; disabled
pdecon_6 = Deconstruct(Point=U_2.u)  # -> XComponent, YComponent, ZComponent; disabled
pt_14 = ConstructPoint(XCoordinate=expr("-x", pdecon_4.YComponent), YCoordinate=pdecon_4.XComponent, ZCoordinate=pdecon_4.ZComponent)
pt_15 = ConstructPoint(XCoordinate=expr("-x", pdecon_6.YComponent), YCoordinate=pdecon_6.XComponent, ZCoordinate=pdecon_6.ZComponent)  # disabled
ext = ExtendCurve(Curve=[rotate_6.Geometry, rotate_5.Geometry], Type=0, Start=panel_11, End=panel_11)  # disabled
group = Group(Objects=ext)  # disabled
move_4 = Move(Geometry=pt_7, Motion=pt_14)  # -> simplify(Geometry), Transform
path_mapper = PathMapper(move_4.Geometry, source="{A}(i)", target="{i}(A)")
move_5 = Move(Geometry=pt_10, Motion=pt_15)  # -> simplify(Geometry), Transform; disabled
group_2 = Group(Objects=flatten(move_4.Geometry))
number_slider_10 = Slider(8, range=0..100)  # disabled
path_mapper_2 = PathMapper(move_5.Geometry, source="{A}(i)", target="{i}(A)")  # disabled
move_6 = Move(Geometry=pt_11, Motion=U_3.u)  # -> simplify(Geometry), Transform
group_3 = Group(Objects=flatten(move_5.Geometry))  # disabled
intcrv = Interpolate(Vertices=path_mapper, Degree=3, Periodic=False, KnotStyle=1)  # -> simplify(flatten(Curve)), Length, Domain
path_mapper_3 = PathMapper(move_6.Geometry, source="{A}(i)", target="{i}(A)")
intcrv_2 = Interpolate(Vertices=move_4.Geometry, Degree=3, Periodic=False, KnotStyle=1)  # -> simplify(flatten(Curve)), Length, Domain
item = ListItem(List=intcrv.Curve, Index=Slider(8, range=0..100), Wrap=True)
intcrv_3 = Interpolate(Vertices=path_mapper_2, Degree=3, Periodic=False, KnotStyle=1)  # -> simplify(flatten(Curve)), Length, Domain; disabled
intcrv_4 = Interpolate(Vertices=move_5.Geometry, Degree=3, Periodic=False, KnotStyle=1)  # -> simplify(flatten(Curve)), Length, Domain; disabled
item_2 = ListItem(List=intcrv_3.Curve, Index=number_slider_10, Wrap=True)  # disabled
intcrv_5 = Interpolate(Vertices=path_mapper_3, Degree=3, Periodic=False, KnotStyle=1)  # -> simplify(flatten(Curve)), Length, Domain
group_4 = Group(Objects=[intcrv_2.Curve, intcrv.Curve])
intcrv_6 = Interpolate(Vertices=move_6.Geometry, Degree=3, Periodic=False, KnotStyle=1)  # -> simplify(flatten(Curve)), Length, Domain
group_5 = Group(Objects=[intcrv_4.Curve, intcrv_3.Curve])  # disabled
group_6 = Group(Objects=[intcrv_6.Curve, intcrv_5.Curve])
